# Dynamo graph AllplanAttributeCollection-Example.dyn (Dynamo 2.12.0.5650)
# packages: IlseDynamo 0.99.21249.9414

file_path = Filename("..\IlseDynamo.Tests\Resources\AttributeDefinitionCollectionLocal_de.xml")
byFileName = IlseDynamo.Allplan.Attributes.ByFileName(fileName=file_path)
toData = IlseDynamo.Allplan.Attributes.ToData(attributes=byFileName)
watch = Watch(toData.ifnr)
watch_2 = Watch(toData.name)
watch_3 = Watch(toData.datatype)
diff = IlseDynamo.Allplan.Attributes.Diff(left=byFileName, right=byFileName)
watch_4 = Watch(diff.equal)
watch_5 = Watch(diff.leftConflicts)
watch_6 = Watch(diff.rightConflicts)
watch_7 = Watch(diff.onlyLeft)
watch_8 = Watch(diff.onlyRight)
toData_2 = IlseDynamo.Allplan.Attributes.ToData(attributes=diff.equal)
watch_9 = Watch(toData_2.name)
