# Dynamo graph AllplanAttributeFavourite-Example.dyn (Dynamo 2.12.0.5650)
# packages: IlseDynamo 0.99.21249.9414

file_path = Filename("out\AllplanAttributeFavourite-Example.xlsx")
file_path_2 = Filename("..\IlseDynamo.Tests\Resources\AttributeFavourite.atfanfx")
code_block = CodeBlock { ""; }
byFileName = IlseDynamo.Allplan.AttributeFavourites.ByFileName(fileName=file_path_2, basePath=code_block)
file_path_3 = Filename("..\IlseDynamo.Tests\Resources\AttributeDefinitionCollectionLocal_de.xml")
byFileName_2 = IlseDynamo.Allplan.Attributes.ByFileName(fileName=file_path_3)
toData = IlseDynamo.Allplan.AttributeFavourites.ToData(attributeFavourites=byFileName, attributeDefinition=byFileName_2)
watch = Watch(toData.name)
watch_2 = Watch(toData.value)
watch_3 = Watch(toData.unknown)
name = IlseDynamo.Allplan.AttributeFavourites.Name(attributeFavourites=byFileName)
watch_4 = Watch(name)
