# Dynamo graph AllplanAttributeLevel-Example.dyn (Dynamo 2.12.0.5650)
# packages: IlseDynamo 0.99.21249.9414

code_block = CodeBlock { ""; }

# group: Reading definition and favourite template
file_path = Filename("..\IlseDynamo.Tests\Resources\AttributeFavourite.atfanfx")
byFileName = IlseDynamo.Allplan.AttributeFavourites.ByFileName(fileName=file_path, basePath=code_block)
file_path_2 = Filename("..\IlseDynamo.Tests\Resources\AttributeDefinitionCollectionLocal_de.xml")
byFileName_2 = IlseDynamo.Allplan.Attributes.ByFileName(fileName=file_path_2)

# group: Example LoI definition of 3 levels
code_block_2 = CodeBlock { [1,2,3]; }
code_block_3 = CodeBlock { ["Schutzwandbauteil","Schalldaemmung", "Datenquelle"]; }
byData = IlseDynamo.Allplan.AttributeMatrix.ByData(levels=code_block_2, attributeNames=code_block_3)
code_block_4 = CodeBlock { [1,2,3]; }
allUpToLevel = IlseDynamo.Allplan.AttributeMatrix.AllUpToLevel(attributeMatrix=byData, level=code_block_4)

ofLevel = IlseDynamo.Allplan.AttributeFavourites.OfLevel(attributeFavourites=byFileName, attributeLevel=allUpToLevel, attributeDefinition=byFileName_2)
toData = IlseDynamo.Allplan.AttributeFavourites.ToData(attributeFavourites=ofLevel)
watch = Watch(toData.ifnr)
watch_2 = Watch(toData.value)
toData_2 = IlseDynamo.Allplan.AttributeFavourites.ToData(attributeFavourites=ofLevel, attributeDefinition=byFileName_2)
watch_3 = Watch(toData_2.name)
watch_4 = Watch(toData_2.value)
