# Dynamo graph GGU-Data-Export-Excel.dyn "Read-Drilling-Data-and-Export-Excel" (Dynamo 2.5.0.7186)
# packages: IL-SE-Dynamo 0.1.0

file_path = Filename("out\Read-Drilling-Data-and-Export-Excel.xlsx")
code_block = CodeBlock { "Example"; }
file_path_2 = Filename("..\IlseDynamo.Tests\Resources\GGUDrillingProfilesExample.xml")
byFileName = GGUStratic.DrillingProbes.ByFileName(fileName=file_path_2)

# group: Assemble Header
code_block_2 = CodeBlock { ["Bezeichnung", "Rechtswert", "Hochwert", "Höhe"]; }
getMaxLayerCount = GGUStratic.DrillingProbes.GetMaxLayerCount(drillingProbes=byFileName)
code_block_3 = CodeBlock(t1=getMaxLayerCount) { 1..t1; }
code_block_4 = CodeBlock(t1=code_block_3) { ["Schicht "+t1, "Tiefe "+t1]; }
transpose = List.Transpose(lists=code_block_4)
flatten = List.Flatten(list=transpose)
join = List.Join(list0=code_block_2, list1=flatten)

getProbeData = GGUStratic.DrillingProbes.GetProbeData(drillingProbes=byFileName)

# group: Data aggregation
getName = GGUStratic.DrillingProbe.GetName(drillingProbe=getProbeData)
getPosition = GGUStratic.DrillingProbe.GetPosition(drillingProbe=getProbeData)
code_block_5 = CodeBlock(name=getName, p=getPosition) { [name, p.X, p.Y, p.Z]; }
getLayerInfo = GGUStratic.DrillingProbe.GetLayerInfo(drillingProbe=getProbeData)
transpose_2 = List.Transpose(lists=getLayerInfo)
getLayerDepth = GGUStratic.DrillingProbe.GetLayerDepth(drillingProbe=getProbeData)
transpose_3 = List.Transpose(lists=getLayerDepth)
code_block_6 = CodeBlock(l1=transpose_2, l2=transpose_3) { List.Transpose([ l1, l2 ]); }
code_block_7 = CodeBlock { 1; }
flatten_2 = List.Flatten(list=code_block_6, amt=code_block_7)
join_2 = List.Join(list0=code_block_5, list1=flatten_2)

# group: Assemble Excel
code_block_8 = CodeBlock { 0; }
code_block_9 = CodeBlock(l1=join) { [l1]; }
transpose_4 = List.Transpose(lists=join_2)
join_3 = List.Join(list0=code_block_9, list1=transpose_4)
exportExcel = Data.ExportExcel(filePath=file_path, sheetName=code_block, startRow=code_block_8, startCol=code_block_8, data=join_3)
